test file "Requirements_Wiper"
  coverage: Decision, MCDC, Condition

suite "Wiper_Suite"

  case "Wiper_TC01" [baseline]
    description: This Test Case Covers the Condition to check Enablement of the Wiper
    tags: TC_01
    model Wiper_New, harness Wiper_New_Harness1 (for Wiper_New/Subsystem), mode Normal
    baseline "Baseline01.mat"
      Wiper_Model

  case "Wiper_TC02" [baseline]
    description: This Test Case Covers the Condition to check Enablement of the Wiper when Rain Sensors are ON
    tags: TC_02
    model Wiper_New, harness Wiper_New_Harness2 (for Wiper_New/Subsystem), mode Normal
    baseline "Baseline02.mat"
      Wiper_Model

  case "Wiper_TC03" [baseline]
    description: This Test Case Covers the Condition to check Enablement of the Wiper when Knob is ON
    tags: TC_03
    model Wiper_New, harness Wiper_New_Harness3 (for Wiper_New/Subsystem), mode Normal
    baseline "Baseline03.mat"
      Wiper_Model

  case "Wiper_TC04" [baseline]
    description: This Test Case Covers the Condition to check Enablement of the Wiper when Rain Sensors and Knob are ON
    tags: TC_04
    model Wiper_New, harness Wiper_New_Harness4 (for Wiper_New/Subsystem), mode Normal
    baseline "Baseline04.mat"
      Wiper_Model

  case "Wiper_TC05" [baseline]
    description: This Test Case Covers the Condition to check Disabling of the Wiper when Ignition is OFF and Rain Sensor and Knob are ON
    tags: TC_05
    model Wiper_New, harness Wiper_New_Harness5 (for Wiper_New/Subsystem), mode Normal
    baseline "Baseline05.mat"
      Wiper_Model

  case "Wiper_TC06" [baseline]
    description: This Test Case Covers the Condition to check Disabling of the Wiper when Ignition is ON and Rain Sensor and Knob are OFF
    tags: TC_06
    model Wiper_New, harness Wiper_New_Harness6 (for Wiper_New/Subsystem), mode Normal
    baseline "Baseline06.mat"
      Wiper_Model